# Grasshopper definition SyncSender_TaskCapable.gh (Grasshopper 1.0.7)
# Copyright: Arup
# plug-ins: Speckle (CX)

arup_uk_sp_stamatios = Accounts(email="stamatios.psarras@arup.com", restapi="https://uk.speckle.arup.com/api")
projects = Projects(Account=arup_uk_sp_stamatios)  # -> Projects, SelectedProject
rectangle = Rectangle(Plane=PlaneXY(0, 0, 0), XSize=Domain(-1, 1), YSize=Domain(-2, 2), Radius=0)  # -> Rectangle, Length
series = Series(Start=0, Step=1, Count=10)
item = ListItem(List=projects.Projects, Index=0, Wrap=True)
dss = DataSenderSync(Account=arup_uk_sp_stamatios, StreamId="8vLlZfYG9", Project=item, A=rectangle.Rectangle, B=series)
drs = DataReceiverSync(Account=arup_uk_sp_stamatios, Stream="8vLlZfYG9")
panel = Panel(dss)
